vi "spectrum _analisis.gvi"   [LabVIEW NXG 1.0.0]
panel controls:
  "duration": f64 = 1
  "window type": "Window Type.gtype" = "Hanning"(1)
  "size": i32 = 10
  "restart": bool
  "recalculate": bool
  "stop": bool
  "file path": path
  "threshold": f64 = 18
  "min peak width": f64 = 1
  "max peak width": f64 = 20
  "save to file": bool
panel indicators:
  "data": waveform<f64>[]
  "spectrum": T1[]
  "out_freq out": f64[]
  "out_amp out": f64[]
  "out_hvw out": f64[]
types:
  "Window Type.gtype" = u32
  T1 = cluster{"f0": f64, "df": f64, "magnitude": f64[]}
uses:
  NI::Analysis::Measurement::FFT Spectrum (Mag-Phase) for N Chan.gvi
  Library.sli::get_peaks
  Library.sli::output_to_file
diagram:
  while {
    sequence {
      frame 0 {
        w1 = "mic"  # task in
        Is Greater(x=$duration, y=0) -> w2
        case (w2) {
          frame False, Default {
            w3 = w1
            w4 = waveform<f64>[] []
            w5 = no error
          }
          frame True {
            call "DAQmx Start Task.gvi"(error in=no error, task in=w1) -> (error out=w6, task out=w7)
            call "DAQmx Read (Analog 1D Wfm NChan NSamp Duration).gvi"(error in=w6, task in=w7, duration=$duration) -> (error out=w5, task out=w3, data=w4)
          }
        }
        while {
          $data <- w4
          call "FFT Spectrum (Mag-Phase) for N Chan.gvi"(signal=w4, window type=$"window type", error in=w5) -> (magnitude=w8, error out=w9)
          $spectrum <- w8
          Initialize Array(element=0, size=$size) -> w10
          Initialize Array(element=0, size=$size) -> w11
          Initialize Array(element=0, size=$size) -> w12
          Array Index(array=w8) -> (out0[0]=w13)
          Property Node(instance in=w13) -> ("magnitude"=w14)
          Property Node(instance in=w13) -> ("df"=w15)
          Array Size(array=w14) -> (size(s)=w16)
          To Unsigned Quad Integer(number=w16) -> w17
          Array Size(array=w11) -> (size(s)=w18)
          To Unsigned Quad Integer(number=w18) -> w19
          Array Size(array=w12) -> (size(s)=w20)
          To Unsigned Quad Integer(number=w20) -> w21
          Array Size(array=w10) -> (size(s)=w22)
          To Unsigned Quad Integer(number=w22) -> w23
          call "get_peaks"(in in=w14, in_size in=w17, out_freq in=w11, out_freq_max_size in=w19, out_hvw in=w12, out_hvw_max_size in=w21, out_amp in=w10, out_amp_max_size in=w23, df in=w15, threshold in=$threshold, min_search_freq in=$"min peak width", max_search_freq in=$"max peak width") -> (out_freq out=w24, out_hvw out=w25, out_amp out=w26)
          $"out_freq out" <- w24
          $"out_hvw out" <- w25
          $"out_amp out" <- w26
          while {
            case ($"save to file") {
              frame False, Default { }
              frame True {
                Array Size(array=w24) -> (size(s)=w27)
                To Unsigned Quad Integer(number=w27) -> w28
                Array Size(array=w25) -> (size(s)=w29)
                To Unsigned Quad Integer(number=w29) -> w30
                Array Size(array=w26) -> (size(s)=w31)
                To Unsigned Quad Integer(number=w31) -> w32
                call "output_to_file"(file_path in=$"file path", freq in=w24, freq_size in=w28, hvw in=w25, hvw_size in=w30, amp in=w26, amp_size in=w32)
              }
            }
            Wait(time to wait=50)
            w33 = $restart
            w34 = $stop
            Logical Or(w33, w34) -> w35
            Logical Or($recalculate, w35) -> w36
            stop if w36
          }
          Logical Or(w33, w34) -> w37
          stop if w37
        }
      }
    }
    sequence {
      frame 0 {
        call "DAQmx Stop Task.gvi"(error in=w9, task in=w3) -> (error out=w38, task out=w39)
        call "DAQmx Clear Task.gvi"(error in=w38, task in=w39)
      }
    }
    stop if w34
  }
